# Grasshopper definition TestGhDefinition.gh (Grasshopper 1.0.7)

subtraction = Subtraction(A=0, B=100)
xy = XYPlane(Origin=Point(0, 0, 0))
number_slider = Slider(-2.7252, range=-100..100)
number_slider_2 = Slider(-1.2687, range=-100..100)
X = UnitX(Factor=subtraction)
move = Move(Geometry=xy, Motion=X)  # -> Geometry, Transform
Y = UnitY(Factor=subtraction)
move_2 = Move(Geometry=move.Geometry, Motion=Y)  # -> Geometry, Transform
sqgrid = Square(Plane=move_2.Geometry, Size=1, ExtentX=Slider(200, range=0..1000), ExtentY=Slider(200, range=0..1000))  # -> Cells, Points
c_script = CSharpScript(x=number_slider, y=number_slider_2)  # -> out, A, B, C, Fitness; inputs x: Double, y: Double
# ---------- c_script: C# ----------
    //evaluate binary f6 function for x and y values
    var num1 = Math.Pow(Math.Sin(Math.Sqrt(x * x + y * y)), 2);
    var num2 = Math.Pow(1 + 0.001 * (x * x + y * y), 2);
    var result = 0.5 + (num1 - 0.5) / num2;
    A = num1;
    A = num2;
    C = result;
    Fitness = 1 - result;
# ---------- end c_script ----------
pdecon = Deconstruct(Point=sqgrid.Points)  # -> XComponent, YComponent, ZComponent
c_script_2 = CSharpScript(x=pdecon.XComponent, y=pdecon.YComponent)  # -> out, A, B, C; inputs x: Double, y: Double
# ---------- c_script_2: C# ----------
    //evaluate binary f6 function for x and y values
    var num1 = Math.Pow(Math.Sin(Math.Sqrt(x * x + y * y)), 2);
    var num2 = Math.Pow(1 + 0.001 * (x * x + y * y), 2);
    var result = 0.5 + (num1 - 0.5) / num2;
    A = num1;
    A = num2;
    C = result;
# ---------- end c_script_2 ----------
multiplication = Multiplication(A=c_script.C, B=100)
multiplication_2 = Multiplication(A=c_script_2.C, B=100)
pt = ConstructPoint(XCoordinate=pdecon.XComponent, YCoordinate=pdecon.YComponent, ZCoordinate=multiplication_2)
button = Button()
pt_2 = ConstructPoint(XCoordinate=number_slider, YCoordinate=number_slider_2, ZCoordinate=multiplication)
pdecon_2 = Deconstruct(Point=flatten(pt))  # -> XComponent, YComponent, ZComponent
sph = Sphere(Base=pt_2, Radius=2)

# ---- group: SimpleGA
c_script_3 = CSharpScript(Run=Toggle(True), Reference="C:\SimpleGA\src\SimpleGA\SimpleGA\bin\Debug\net48\SimpleGA.dll")  # -> out, X, Y; inputs Run: Boolean
# ---------- c_script_3: C# usings ----------
using SimpleGA;
# ---------- c_script_3: C# ----------
    //Arrange
    var configuration = new GeneticSolverConfiguration();
    configuration.PopulationSize = 1000;
    configuration.Generations = 100;
    configuration.IndividualGeneCount = 44;
    configuration.MutationProbability = 0.065;
    configuration.CrossoverProbability = 0.85;
    configuration.ElitismPercentage = 0.02;
    var solver = new GeneticSolver(configuration);

    Print("-------------------------INITIAL POPULATION-------------------------");
    foreach (var individual in solver.Population.TopFive)
    {
      Print(FitnessFunctionBinaryF6.DecodeDnaBinarySequence(individual).ToString());
    }

    //Act
    double x = double.NaN;
    double y = double.NaN;
    Population finalPop = null;

    if(Run)
    {
      solver.Run(new FitnessFunctionBinaryF6());
      finalPop = solver.Population;
    }

    //Assert
    Print("-------------------------FINAL POPULATION-------------------------");
    //_testOutput.WriteLine($"Average Fitness: {solver.Population.FitnessAverage}");
    //_testOutput.WriteLine($"Max Fitness: {solver.Population.FitnessMax}");
    foreach (var individual in finalPop.TopFive)
    {
      Print(FitnessFunctionBinaryF6.DecodeDnaBinarySequence(individual).ToString());
    }

    var result = FitnessFunctionBinaryF6.DecodeDnaBinarySequence(finalPop.Individuals[0]);
    x = result.Item1;
    y = result.Item2;


    X = x;
    Y = y;
# ---------- end c_script_3 ----------

# ----
sort = SortList(Keys=pdecon_2.ZComponent, ValuesA=flatten(pt))  # -> Keys, ValuesA
galapagos = Galapagos(fitness=num, gene=[number_slider, number_slider_2])
num = Number(c_script.Fitness)
panel = Panel(c_script_3.X)
panel_2 = Panel(c_script_3.Y)
item = ListItem(List=sort.ValuesA, Index=0, Wrap=True)
panel_3 = Panel(c_script_3.out)
